# Grasshopper definition tool-no-holes.gh (Grasshopper 1.0.7)
# plug-ins: Heteroptera, Human, RhinoCodePluginGH

crv = Curve()
crv_2 = Curve([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])
boundary = GetGeometry(crv, AtLeast=1, AtMost=100, DeleteInput=False, Filter=3220963270, Prompt="Set Boundary", TreeAccess=False)
swatch = ColourSwatch(SwatchColor=RGB(255, 254, 254))
swatch_2 = ColourSwatch(SwatchColor=RGBA(204, 0, 0, 197))
toggle = BooleanToggle(False)
project = Project(Geometry=boundary, Plane=PlaneXY(0, 0, 0))  # -> Geometry, Transform
swatch_3 = ColourSwatch(SwatchColor=RGBA(48, 48, 48, 66))
boundary_2 = BoundarySurfaces(Edges=project.Geometry)
edges = BrepEdges(Brep=boundary_2)  # -> Naked, Interior, NonManifold
brep = Brep([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])
previewlw = CustomPreviewLineweights(Geometry=edges.Naked, Shader=ColourSwatch(SwatchColor=RGB(59, 59, 59)), Thickness=Slider(2, range=0..10), Absolute=False)
Z = UnitZ(Factor=Slider(41849, range=0..100000))
previewlw_2 = CustomPreviewLineweights(Geometry=crv_2, Shader=ColourSwatch(SwatchColor=RGB(255, 254, 254)), Thickness=Slider(2, range=0..10), Absolute=False)
debrep = DeconstructBrep(Brep=brep)  # -> Faces, Edges, Vertices
avr = Average(Input=debrep.Vertices)  # -> flatten(ArithmeticMean)
extr = Extrude(Base=boundary_2, Direction=Z)
brepsinc = PointInBreps(Brep=extr, Point=avr, Strict=False)  # -> Inside, Index
get_string = GetString(AtLeast=1, AtMost=1, TreeAccess=False)
bool = Boolean(invert(brepsinc.Inside))
int = Integer(bool)
pt_py = PointsToPy(x=get_string)  # -> a
# ---------- pt_py: Python ----------
__author__ = "andrewastakhov"

import rhinoscriptsyntax as rs
a=x is not None
# ---------- end pt_py ----------
addition = Addition(A=int, B=1)
dispatch = DispatchUnweave(Data=brep, Pattern=addition)  # -> Out00, Out01, Out02
setup_python = Polygon(x=addition, y=get_string, run=pt_py)  # -> out; inputs x: list of Int32, y: String, run: Boolean
# ---------- setup_python: Python ----------
import json, os 
from collections import Counter
import requests

if run:
    r=requests.post(f"http://localhost:7711/masks/add/{y}", json={
        "state":True,
        "masks":list(x)

    })
    print(r.text)
# ---------- end setup_python ----------
preview = CustomPreview(Geometry=dispatch.Out00, Material=ColourSwatch(SwatchColor=RGBA(161, 161, 161, 133)))
preview_2 = CustomPreview(Geometry=dispatch.Out01, Material=ColourSwatch(SwatchColor=RGBA(204, 75, 75, 133)))
context_print = ContextPrint(Text=setup_python)
context_bake = ContextBake(Geometry=dispatch.Out00)
panel = Panel(setup_python)
