# Grasshopper definition tool2.gh (Grasshopper 1.0.7)
# plug-ins: Heteroptera, RhinoCodePluginGH, Human

crv = Curve([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])
boundary = GetGeometry(AtLeast=1, AtMost=1, DeleteInput=False, Filter=3220963270, Prompt="Set Boundary", TreeAccess=False)
holes = GetGeometry(AtLeast=0, AtMost=1000, DeleteInput=False, Filter=3220963270, TreeAccess=False)
swatch = ColourSwatch(SwatchColor=RGB(255, 254, 254))
swatch_2 = ColourSwatch(SwatchColor=RGBA(204, 0, 0, 197))
project = Project(Geometry=boundary, Plane=PlaneXY(0, 0, 0))  # -> Geometry, Transform
project_2 = Project(Geometry=holes, Plane=PlaneXY(0, 0, 0))  # -> Geometry, Transform
crv_2 = Curve(<curve referenced from the Rhino model>)
crv_3 = Curve(<curve referenced from the Rhino model>)
merge = Merge(Data1=crv_2, Data2=crv_3)
boundary_2 = BoundarySurfaces(Edges=crv)
edges = BrepEdges(Brep=boundary_2)  # -> Naked, Interior, NonManifold
brep = Brep([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])
previewlw = CustomPreviewLineweights(Geometry=edges.Naked, Shader=ColourSwatch(SwatchColor=RGB(59, 59, 59)), Thickness=Slider(2, range=0..10), Absolute=False)
S = Script(x=merge)  # -> out, a; inputs x: list of Curve
# ---------- S: Python ----------
"""Grasshopper Script"""


import rhinoscriptsyntax as rs 

a=rs.coercegeometry(rs.AddPlanarSrf(x))
print(a)
# ---------- end S ----------
Z = UnitZ(Factor=Slider(41849, range=0..100000))
previewlw_2 = CustomPreviewLineweights(Geometry=swatch_2, Shader=ColourSwatch(SwatchColor=RGB(255, 254, 254)), Thickness=Slider(2, range=0..10), Absolute=False)
extr = Extrude(Base=boundary_2, Direction=Z)
smesh = SimpleMesh(Brep=brep)
extr_2 = Extrude(Base=S.a, Direction=Z)
sint = SolidIntersection(BrepsA=extr, BrepsB=extr_2)
debrep = DeconstructBrep(Brep=sint)  # -> Faces, Edges, Vertices
item = ListItem(List=debrep.Faces, Index=0, Wrap=True)
shapein = ShapeInBrep(Brep=sint, Shape=brep)  # -> flatten(Relation)
get_string = GetString("default", AtLeast=1, AtMost=1, Prompt="Set any name for this selection", TreeAccess=False)
preview = CustomPreview(Geometry=item, Material=swatch_2)
item_2 = ListItem(List=smesh, Index=0, Wrap=True)
dispatch = DispatchUnweave(Data=brep, Pattern=shapein)  # -> Out00, Out01, Out02
setup_python = Polygon(x=shapein, y=get_string)  # -> out; inputs x: list of Int32, y: String
# ---------- setup_python: Python ----------
import json, os 
from collections import Counter
with open(f"{os.getenv('HOME')}/dev/swdata/masks/{y}.json", "w")as f:
    json.dump(list(x), f)
    cnt=Counter(list(x))
    print(f'''
        outside: {cnt[2]},
        inside: {cnt[0]},
        onboarder:  {cnt[1]}'''
    )
# ---------- end setup_python ----------
preview_2 = CustomPreview(Geometry=dispatch.Out00, Material=ColourSwatch(SwatchColor=RGBA(161, 161, 161, 133)))
preview_3 = CustomPreview(Geometry=dispatch.Out02, Material=ColourSwatch(SwatchColor=RGBA(48, 48, 48, 66)))
context_print = ContextPrint(Text=setup_python)
preview_4 = CustomPreview(Geometry=dispatch.Out01, Material=ColourSwatch(SwatchColor=RGBA(204, 75, 75, 133)))
