# Grasshopper definition unnamed.gh (Grasshopper 1.0.7)

pt = Point([<point referenced from the Rhino model> x5000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])
project = Project(Geometry=pt, Plane=PlaneXY(0, 0, 0))  # -> Geometry, Transform
vrot = Rotate()
scale = Scale(Center=Point(0, 0, 0), Factor=0.5)  # -> Geometry, Transform
X = UnitX(Factor=1)
line = Line(X)
pt_2 = Point(Point(0, 0, 0))
number_slider = Slider(90, range=0..100)
addition = Addition(A=pt_2, B=X)
ln = Line(StartPoint=pt_2, EndPoint=addition)
rotax = RotateAxis(Angle=Slider(1.571, range=0..10), Axis=ln)  # -> Geometry, Transform
transform = Transform(Geometry=pt, Transform=rotax.Transform)
